% Simulink data dictionary rev3_data.sldd

MC_DC_State = enum(DefaultValue="Disabled")
  Disabled = 0
  Enabled = 1
  Speed_Check = 2
  Active = 3
  Complete = 4

MC_VSM_State = enum(DefaultValue="Start")
  Start = 0
  PC_Init = 1
  PC_Active = 2
  PC_Finish = 3
  Wait = 4
  Ready = 5
  Motor_Running = 6
  Fault = 7
  Shutdown = 14
  Recycle_Power = 15

BMS_Contactor_Command = enum(DefaultValue="Open_Contactor")
  Open_Contactor = 0
  Close_Contactor = 1
  Stay = 2

CAN = Simulink.Bus()
  Inverter_DC: boolean
  Inverter_EN: boolean
  BMS_Contactor: Enum: BMS_Contactor_Command
  MC_PS: double
  Batt_PS: double
  HIB_EN: boolean
  HUDL_EN: boolean
  TMS_EN: boolean
  GUB_EN: boolean
  Acc_EN: boolean
  Batt_12V_EN: boolean
  Torque: int16

UC_State = enum(DefaultValue="Preset")
  MC_Off = 8
  MC_Init = 1
  Contactor_Closed = 2
  MC_Active = 3
  Contactor_Open = 4
  MC_Discharging = 5
  Fault = 6
  Estop = 7
  Preset = 0
  LVSS_MC_Startup = 9
  LVSS_MC_Shutdown = 10
  Key_Cycle = 11

Sig = Simulink.Signal()